# Grasshopper definition Components bookWorm.gh (Grasshopper 1.0.7)
# plug-ins: Bookworm

toggle = BooleanToggle(True)
number_slider = Slider(2, range=0..10)
connumberformat = ConstructNumberFormat(NumberFormatType="1")
conpadding = ConstructPadding(Top="1")
concellborder = ConstructCellBorder(Style="5", Color=ColourSwatch(SwatchColor=RGB(0, 42, 255)))
contextformat = ConstructTextFormat(
    ForegroundColor=ColourSwatch(SwatchColor=RGB(196, 0, 255)),
    FontFamily="Arial",
    FontSize=Slider(14, range=0..100),
    Bold=toggle,
    Italic=toggle,
    Strikethrought=toggle,
    Underline=toggle,
    Link="http://parametrica.team")
contextrotation = ConstructTextRotation(Angle=Slider(90, range=0..100), Vertical=Toggle(False))
number_slider_2 = Slider(500, range=0..1000)
panel = Panel("""Количество комнат
Евро
Студия""")
concellborders = ConstructCellBorders(BorderTop=concellborder)
panel_2 = Panel("136sKKVnzYGOcDbLzDCTKq6zVEHlm_2nUyYPIjH6f-F4")
conextendedvalue = ConstructExtendedValue(Value=panel)
concellformat = ConstructCellFormat(
    NumberFormat=connumberformat,
    Color=ColourSwatch(SwatchColor=RGB(193, 209, 192)),
    Borders=concellborders,
    Padding=conpadding,
    HorizontalAligment=number_slider,
    VerticalAligment=number_slider,
    Wrap=number_slider,
    TextDirection=Toggle(True),
    TextFormat=contextformat)
concellformat_2 = ConstructCellFormat(NumberFormat=connumberformat)
concell = ConstructCell()
panel_3 = Panel(concellformat_2)
panel_4 = Panel("A1:B2")
concell_2 = ConstructCell(UserEnteredValue=conextendedvalue, CellFormat=concellformat_2)
readcell = ReadCell(SpreadsheetId=panel_2, SheetName="Квартирография_1", CellRange="A1:A2", Read=Toggle(True), SameLength=False)
decell = DeconstructCell(Cell=readcell)  # -> FormattedValue, UserEnteredValue, CellFormat
writecell = WriteCellRange(SpreadsheetId=panel_2, SheetName="New Shit", CellRange="C10", Values=panel, Append=False, Write=Toggle(True))
concell_3 = ConstructCell(UserEnteredValue=decell.UserEnteredValue, CellFormat=decell.CellFormat)  # -> flatten(Cell)
nickname = UpdateCells(SpreadsheetId=panel_2, SheetName="Квартирография_1", Cells=concell_3, Range="A1:A2", Fields="*", Run=Toggle(False))
